# Grasshopper definition Remap+Ranking_Internalised.gh (Grasshopper 1.0.7)
# plug-ins: Hops, Pufferfish

data = Data(Tree({1}: ["0.301182", "0.342825", "0.284495", "0.181715", "0.146827", "0.05615"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], {2}: ["3405.991345", "3502.110836", "3814.623091", "4403.491978", "5186.850109", "5678.610205"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], {3}: ["3531.819902", "3717.218651", "4086.491918", "4472.188433", "5015.663582", "5691.043978"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], {4}: ["0.007689", "0.005114", "0.007488", "0.017117", "0.014787", "0.035047"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], {5}: ["0", "0", "0", "0", "0", "0"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], {6}: ["0.006931", "0.010971", "0.006773", "0.002435", "0.002337", "0.002865"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], {7}: ["7.811251", "7.944987", "0", "11.5579", "0", "0"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], {8}: ["0.02299", "0.034569", "0.023609", "0.010901", "0.010626", "0.004203"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]))
# Hexagon Curves
# Amenities
# Parks
curve = Curve([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])
# Public Transport
data_2 = Data(Tree({1}: ["12", "12", "11", "8", "4", "3", "0", "0", "2", "9"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], {2}: ["2", "2", "2", "0", "0", "0", "0", "0", "0", "0"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], {3}: ["4", "4", "5", "11", "12", "12", "14", "14", "10", "7"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]))
data_3 = Data([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])
panel = Panel(data)
panel_2 = Panel(data_2)
series = Series(Start="1", Step=1, Count="8")
cull_index = CullIndex(List=series, Indices=expr("x-1", ["2", "3"]), Wrap=True)
tree_branch = TreeBranch(Tree=data, Path=cull_index, MaintainPaths=True)
tree_branch_2 = TreeBranch(Tree=data, Path=["3", "2"], MaintainPaths=True)
bounds = Bounds(Numbers=tree_branch_2)
deconstruct_domain = DeconstructDomain(Domain=bounds)  # -> Start, End
construct_domain = ConstructDomain(DomainStart=deconstruct_domain.End, DomainEnd=deconstruct_domain.Start)
bounds_2 = Bounds(Numbers=tree_branch)
remap_numbers = RemapNumbers(Value=tree_branch_2, Source=construct_domain, Target=Domain(0, 1))  # -> Mapped, Clipped
remap_numbers_2 = RemapNumbers(Value=tree_branch, Source=bounds_2, Target=Domain(0, 1))  # -> Mapped, Clipped
panel_3 = Panel(bounds_2)
panel_4 = Panel(remap_numbers_2.Mapped)
flip_matrix = FlipMatrix(Data=remap_numbers.Mapped)
flip_matrix_2 = FlipMatrix(Data=remap_numbers_2.Mapped)
merge = Merge(Data1=flip_matrix, Data2=flip_matrix_2)
mass_addition = MassAddition(Input=merge)  # -> flatten(Result), PartialResults
bounds_3 = Bounds(Numbers=mass_addition.Result)
quick_graph = QuickGraph(mass_addition.Result, SortOrder=0)
remap_numbers_3 = RemapNumbers(Value=mass_addition.Result, Source=bounds_3, Target=Domain(0, 1))  # -> Mapped, Clipped
# Preview the classification
graph_mapper = GraphMapper(remap_numbers_3.Mapped, x0=0, x1=1, y0=0, y1=1, container_name="Bezier", cpx=[0, 0.8399885893, 0, 1], cpy=[0, 0, 1, 1])
gradient = Gradient(LowerLimit=0, UpperLimit=1, Parameter=graph_mapper, stops=[0: RGB(0, 128, 0), 0.5: RGB(255, 255, 0), 1: RGB(255, 0, 0)])
curve_2 = Curve(curve)
surface = Surface(curve_2)

# ----
# The least score hexagons
number_slider = Slider(0.3, range=0..1)
smaller_than = SmallerThan(FirstNumber=graph_mapper, SecondNumber=number_slider)  # -> SmallerThan, OrEqualTo
dispatch = Dispatch(List=surface, DispatchPattern=smaller_than.SmallerThan)  # -> ListA, ListB
surface_2 = Surface(dispatch.ListA)
xy_plane = XYPlane(Origin=Point(0, 0, 0))
area = Area(Geometry=curve_2)  # -> Area, Centroid
area_2 = Area(Geometry=surface_2)  # -> Area, Centroid
region_union = RegionUnion(Curves=data_3, Plane=xy_plane)
point_in_curve = PointInCurve(Point=area_2.Centroid, Curve=region_union)  # -> Relationship, Point
dispatch_2 = Dispatch(List=surface_2, DispatchPattern=point_in_curve.Relationship)  # -> ListA, ListB
surface_3 = Surface(dispatch_2.ListA)
area_3 = Area(Geometry=surface_3)  # -> Area, Centroid
closest_point = ClosestPoint(Point=area_3.Centroid, Cloud=area.Centroid)  # -> ClosestPoint, CPIndex, Distance
tree_branch_3 = TreeBranch(Tree=merge, Path=closest_point.CPIndex, MaintainPaths=True)

area_4 = Area(Geometry=surface)  # -> Area, Centroid
year = Slider(2037, range=2000..2050)
rangevalue2 = GetNumber(Slider(2, range=0..5), AtLeast=1, AtMost=2147483647, Maximum=1.797693135e+308, Minimum=-1.797693135e+308)
# Metric Number
# Year of Prediction
rangevalue = GetNumber(Slider(1000, range=0..1000), AtLeast=1, AtMost=2147483647, Maximum=1.797693135e+308, Minimum=-1.797693135e+308)
rangevalue1 = GetNumber(year, AtLeast=1, AtMost=2147483647, Maximum=1.797693135e+308, Minimum=-1.797693135e+308)
# 0. Change in Green Space for each hexagon
# 1. Change in Ratio of Amenities per hexagon
# 2. Change in Public Transport per hexagon
point = Point(Point(8903.279567, 3835.48546, 0))
surface_4 = Surface(curve_2)
# Select this to move the point
# across the city map
point_2 = GetPoint(point, AtLeast=1, AtMost=2147483647, Realtime=True)
area_5 = Area(Geometry=surface_4)  # -> Area, Centroid
closest_point_2 = ClosestPoint(Point=point_2, Cloud=area_5.Centroid)  # -> ClosestPoint, CPIndex, Distance
list_item = ListItem(List=curve_2, Index=closest_point_2.CPIndex, Wrap=True)
# Pedro's Metric
pedro_s_metric = Slider(10, range=0..10)
# Pedro's Metric
pedro_s_metric_2 = Slider(8, range=0..10)

# ---- group: RH_OUT:hex
# Selected Hexagon
crv = Curve(list_item)

# ----
# Pedro's Metric
pedro_s_metric_3 = Slider(1, range=0..10)
pedro_s_metric_4 = Slider(6, range=0..10)
# Keshava's Metric
number_slider_2 = Slider(3, range=0..10)
# Pedro's Metric
pedro_s_metric_5 = Slider(9, range=0..10)
# Pedro's Metric
pedro_s_metric_6 = Slider(3, range=0..10)
tree_branch_4 = TreeBranch(Tree=data, Path="8", MaintainPaths=False)
list_item_2 = ListItem(List=merge, Index=Slider(4, range=0..10), Wrap=True)
number = Number(101826.6346)
multiplication = Multiplication(A=tree_branch_4, B=number)
list_item_3 = ListItem(List=merge, Index=number_slider_2, Wrap=True)
flip_matrix_3 = FlipMatrix(Data=data_2)
round = Round(Number=multiplication)  # -> Nearest, Floor, Ceiling
list_item_4 = ListItem(List=merge, Index=Slider(5, range=0..10), Wrap=True)
panel_5 = Panel(list_item_3)
list_item_5 = ListItem(List=flip_matrix_3, Index=Slider(2, range=0..2), Wrap=True)
number_2 = Number(simplify(graft(round.Nearest)))
tree_branch_5 = TreeBranch(Tree=list_item_5, Path=closest_point.CPIndex, MaintainPaths=True)
# Population per hexagon
panel_6 = Panel(round.Nearest)
bounds_4 = Bounds(Numbers=panel_6)
bounds_5 = Bounds(Numbers=flatten(panel_6))
remap_numbers_4 = RemapNumbers(Value=panel_6, Source=bounds_4, Target=Domain(0, 1))  # -> Mapped, Clipped
remap_numbers_5 = RemapNumbers(Value=flatten(panel_6), Source=bounds_5, Target=Domain(0, 1))  # -> Mapped, Clipped
number_slider_3 = Slider(1000, range=0..1000)
graph_mapper_2 = GraphMapper(remap_numbers_5.Mapped, x0=0, x1=1, y0=0, y1=1, container_name="Sigmoid-Logits", e=0.2467943281, t0=-100, t1=100)
data_4 = Data(graph_mapper_2)
gradient_2 = Gradient(
    LowerLimit=0,
    UpperLimit=1,
    Parameter=graph_mapper_2,
    stops=[0: RGB(0, 128, 0), 0.29: RGB(255, 255, 0), 0.624: RGB(255, 0, 0)])
data_5 = Data(gradient_2)
data_6 = Data(Tree({0}: ["Santo António"], {1}: ["Parque das Nações"], {2}: ["Marvila"], {3}: ["Ajuda"], {4}: ["Areeiro"], {5}: ["Santa Maria Maior"]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))
data_7 = Data(number_2)
# Plan or Bar graph?
boolean_toggle = BooleanToggle(True)

# ---- group: RH_IN:Plan
boolean = Boolean(True)

# ----
# Representation
boolean_toggle_2 = BooleanToggle(True)

# ---- group: RH_IN:Circle
boolean_2 = Boolean(boolean_toggle_2)

# ----
circle = Circle(Plane=point_2, Radius=rangevalue)

# ---- group: RH_OUT:dist
crv_2 = Curve(simplify(data_3))

# ----
number_slider_4 = Slider(0.09, range=0.01..0.1)
construct_point = ConstructPoint(
    XCoordinate=expr("-x", Slider(6070, range=0..10000)),
    YCoordinate=expr("-x", Slider(4448, range=0..10000)),
    ZCoordinate=0)

# ----
# Keshava's Metrics
# Pedro's Metrics
# ML Prediction
# Mass to void ratio in hexagon
# Hops
# Closest distance to healthcare
# Closest distance to Parks
# Amenities per capita
# number of education facilities per capita
# Area of Green Space per capita
# Area of commercial to residential in a hexagon
# Population density in hexagon
panel_7 = Panel("""Hospital_beds_per_1000
Green_Energy_produced
Investment_Heath_GDP
Newborns
Population
Poverty_rate
Price_Index
Road_Accidents_yr
School_leavers_rate
Transportation_metro
Solid_waste_collection""")

hops = Hops(
    Year_to_predict="2020",
    CacheResultsInMemory=False,
    CacheSolveResults=False,
    RemoteDefinitionLocation="https://urbanai.herokuapp.com/prediction",
    RemoteSolveVersion=(0, 1, 0))
hops_2 = Hops(
    Year_to_predict=rangevalue1,
    CacheResultsInMemory=False,
    CacheSolveResults=False,
    RemoteDefinitionLocation="https://urbanai.herokuapp.com/prediction",
    RemoteSolveVersion=(0, 1, 0))

panel_8 = Panel(hops)
panel_9 = Panel(hops_2)

split_list = SplitList(List=panel_8, Index="11")  # -> ListA, ListB
split_list_2 = SplitList(List=panel_9, Index="11")  # -> ListA, ListB
panel_10 = Panel(split_list.ListA)
panel_11 = Panel(split_list_2.ListA)

list_item_6 = ListItem(List=split_list_2.ListA, Index=pedro_s_metric_2, Wrap=True)
list_item_7 = ListItem(List=panel_10, Index=pedro_s_metric_2, Wrap=True)
list_item_8 = ListItem(List=split_list_2.ListA, Index=pedro_s_metric, Wrap=True)
list_item_9 = ListItem(List=panel_10, Index=pedro_s_metric, Wrap=True)
division = Division(A=list_item_6, B=list_item_7)
panel_12 = Panel(list_item_8)
list_item_10 = ListItem(List=panel_10, Index=pedro_s_metric_4, Wrap=True)
list_item_11 = ListItem(List=split_list_2.ListA, Index=pedro_s_metric_4, Wrap=True)
list_item_12 = ListItem(List=panel_10, Index=pedro_s_metric_5, Wrap=True)
list_item_13 = ListItem(List=split_list_2.ListA, Index=pedro_s_metric_5, Wrap=True)
division_2 = Division(A=list_item_8, B=list_item_9)
list_item_14 = ListItem(List=split_list_2.ListA, Index=pedro_s_metric_3, Wrap=True)
list_item_15 = ListItem(List=panel_10, Index=pedro_s_metric_3, Wrap=True)
division_3 = Division(A=list_item_13, B=list_item_12)
division_4 = Division(A=list_item_11, B=list_item_10)
list_item_16 = ListItem(List=split_list_2.ListA, Index=pedro_s_metric_6, Wrap=True)
list_item_17 = ListItem(List=panel_10, Index=pedro_s_metric_6, Wrap=True)
multiplication_2 = Multiplication(A=division, B=list_item_2)
division_5 = Division(A=list_item_14, B=list_item_15)
division_6 = Division(A=list_item_16, B=list_item_17)
multiplication_3 = Multiplication(A=division_4, B=panel_5)
multiplication_4 = Multiplication(A=division_5, B=list_item_4)
multiplication_5 = Multiplication(A=division_6, B="23")
multiplication_6 = Multiplication(A=division_3, B=tree_branch_5)
# Predicted Increase in Educational Facilities pre Capita
panel_13 = Panel(multiplication_2)
subtraction = Subtraction(A=multiplication_5, B="23")
# Predicted Increase in Green Space pre Capita
panel_14 = Panel(multiplication_4)
# Predicted Ratio of Amenities per Capita
panel_15 = Panel(multiplication_3)
# Pred number of Public Transport
panel_16 = Panel(multiplication_6)
multiplication_7 = Multiplication(A=division_2, B=remap_numbers_4.Mapped)
mass_addition_2 = MassAddition(Input=multiplication_7)  # -> Result, PartialResults
# Change in Requirement of Hospitals
panel_17 = Panel(subtraction)
subtraction_2 = Subtraction(A=panel_13, B=list_item_2)
multiplication_8 = Multiplication(A=mass_addition_2.Result, B=number_slider_3)
# Change in Green Space per Capita
subtraction_3 = Subtraction(A=panel_14, B=list_item_4)
subtraction_4 = Subtraction(A=panel_16, B=list_item_5)
# Change in Ratio of Amenities per Capita
subtraction_5 = Subtraction(A=panel_15, B=panel_5)
panel_18 = Panel(subtraction_2)
panel_19 = Panel(subtraction_3)
panel_20 = Panel(multiplication_8)
panel_21 = Panel(subtraction_5)
multiplication_9 = Multiplication(A=multiplication_7, B=number_slider_3)  # -> simplify(graft(Result))
multiplication_10 = Multiplication(A=simplify(graft(round.Nearest)), B=panel_21)
multiplication_11 = Multiplication(A=simplify(graft(round.Nearest)), B=panel_18)  # -> simplify(Result)
multiplication_12 = Multiplication(A=simplify(graft(round.Nearest)), B=panel_19)

# ----
# Pedro's metrics
number_3 = Number(split_list_2.ListB)
number_4 = Number(split_list.ListB)
panel_22 = Panel(number_3)
panel_23 = Panel(number_4)
bounds_6 = Bounds(Numbers=panel_22)
bounds_7 = Bounds(Numbers=panel_23)
construct_domain_2 = ConstructDomain(DomainStart=0, DomainEnd="14")
construct_domain_3 = ConstructDomain(DomainStart=0, DomainEnd="14")
remap_numbers_6 = RemapNumbers(Value=panel_22, Source=bounds_6, Target=construct_domain_2)  # -> Mapped, Clipped
remap_numbers_7 = RemapNumbers(Value=panel_23, Source=bounds_7, Target=construct_domain_3)  # -> Mapped, Clipped
sort_text = SortText(Keys=flatten(data_6), Values=flatten(data_3), Culture=127)  # -> Keys, Values
panel_24 = Panel(remap_numbers_7.Mapped)
panel_25 = Panel(remap_numbers_6.Mapped)
surface_5 = Surface(sort_text.Values)
area_6 = Area(Geometry=surface_5)  # -> Area, Centroid
mass_addition_3 = MassAddition(Input=panel_24)  # -> Result, PartialResults
closest_point_3 = ClosestPoint(Point=point, Cloud=area_6.Centroid)  # -> ClosestPoint, CPIndex, Distance
gradient_3 = Gradient(LowerLimit=0, UpperLimit="14", Parameter=panel_25, stops=[0: RGB(0, 128, 0), 0.5: RGB(255, 255, 0), 1: RGB(255, 0, 0)])
mass_addition_4 = MassAddition(Input=panel_25)  # -> Result, PartialResults
panel_26 = Panel(mass_addition_3.Result)
list_item_18 = ListItem(List=sort_text.Keys, Index=closest_point_3.CPIndex, Wrap=True)  # -> flatten(Item)
panel_27 = Panel(mass_addition_4.Result)
panel_28 = Panel(list_item_18)

# ----
# Solid Waste Generation
panel_29 = Panel(multiplication_9)
# Change in Ratio of Amenities per hexagon
panel_30 = Panel(multiplication_10)
# Change in Public Transport
panel_31 = Panel(subtraction_4)
# Change in Green Space for each hexagon
panel_32 = Panel(multiplication_12)
# Predicted Increase in Educational Facilities for each hexagon
panel_33 = Panel(multiplication_11)
bounds_8 = Bounds(Numbers=flatten(panel_29))
bounds_9 = Bounds(Numbers=flatten(panel_32))
round_to_decimal_place = RoundToDecimalPlace(NumberX=panel_30, DecimalPlace="2", RoundType=0)  # -> Rounded, Difference
bounds_10 = Bounds(Numbers=flatten(panel_31))
bounds_11 = Bounds(Numbers=flatten(panel_33))
remap_numbers_8 = RemapNumbers(Value=flatten(panel_31), Source=bounds_10, Target=Domain(0, 1))  # -> Mapped, Clipped
remap_numbers_9 = RemapNumbers(Value=flatten(panel_29), Source=bounds_8, Target=Domain(0, 1))  # -> Mapped, Clipped
remap_numbers_10 = RemapNumbers(Value=flatten(panel_32), Source=bounds_9, Target=Domain(0, 1))  # -> Mapped, Clipped
bounds_12 = Bounds(Numbers=flatten(round_to_decimal_place.Rounded))
remap_numbers_11 = RemapNumbers(Value=flatten(panel_33), Source=bounds_11, Target=Domain(0, 1))  # -> Mapped, Clipped
graph_mapper_3 = GraphMapper(remap_numbers_8.Mapped, x0=0, x1=1, y0=0, y1=1, container_name="Sigmoid-Logits", e=0.7139804363, t0=-100, t1=100)
data_8 = Data(graph_mapper_3)
graph_mapper_4 = GraphMapper(remap_numbers_9.Mapped, x0=0, x1=1, y0=0, y1=1, container_name="Sigmoid-Logits", e=0.2467943281, t0=-100, t1=100)
data_9 = Data(graph_mapper_4)
graph_mapper_5 = GraphMapper(remap_numbers_10.Mapped, x0=0, x1=1, y0=0, y1=1, container_name="Sigmoid-Logits", e=0.2467943281, t0=-100, t1=100)
data_10 = Data(graph_mapper_5)
graph_mapper_6 = GraphMapper(remap_numbers_11.Mapped, x0=0, x1=1, y0=0, y1=1, container_name="Sigmoid-Logits", e=0.2467943281, t0=-100, t1=100)
data_11 = Data(graph_mapper_6)
# METRIC4
# Predicted Increase / Decrease in Solid Waste Generation
# METRIC5
# Population density per hexagon
gradient_4 = Gradient(
    LowerLimit=0,
    UpperLimit=1,
    Parameter=graph_mapper_4,
    stops=[0.138: RGB(255, 255, 255), 0.307: RGB(255, 255, 255), 0.542: RGB(79, 55, 25)])
data_12 = Data(gradient_4)
remap_numbers_12 = RemapNumbers(Value=flatten(round_to_decimal_place.Rounded), Source=bounds_12, Target=Domain(0, 1))  # -> Mapped, Clipped
# METRIC 3
# Predicted Increase in Educational Facilities for each hexagon
gradient_5 = Gradient(LowerLimit=0, UpperLimit=1, Parameter=graph_mapper_6, stops=[0.15: RGB(255, 255, 255), 0.85: RGB(208, 0, 255)])
data_13 = Data(gradient_5)
# Change in Public Transport per hexagon
gradient_6 = Gradient(
    LowerLimit=0,
    UpperLimit=1,
    Parameter=flatten(graph_mapper_3),
    stops=[0: RGB(0, 128, 0), 0.5: RGB(255, 255, 0), 1: RGB(255, 0, 0)])
data_14 = Data(gradient_6)
# METRIC0
# Change in Green Space for each hexagon
gradient_7 = Gradient(
    LowerLimit=0,
    UpperLimit=1,
    Parameter=flatten(graph_mapper_5),
    stops=[0: RGB(0, 98, 0), 0.25: RGB(175, 255, 122), 0.5: RGB(255, 255, 255), 0.75: RGB(235, 235, 235), 1: RGB(255, 255, 255)])
data_15 = Data(gradient_7)
line_sdl = LineSDL(Start=area_6.Centroid, Direction=Vector(0, 0, 1), Length=Slider(275, range=0..1000))
data_16 = Data(panel_29)
data_17 = Data(panel_32)
data_18 = Data(round_to_decimal_place.Rounded)
data_19 = Data(panel_31)
data_20 = Data(panel_33)
graph_mapper_7 = GraphMapper(remap_numbers_12.Mapped, x0=0, x1=1, y0=0, y1=1, container_name="Bezier", cpx=[0, 0.25, 0.75, 1], cpy=[0, 0.25, 0.75, 1])
data_21 = Data(graph_mapper_7)
stream_filter = StreamFilter(Gate=rangevalue2, Stream0=data_10, Stream1=data_21, Stream2=data_8, Stream3=data_11, Stream4=data_9, Stream5=data_4)
multiplication_13 = Multiplication(A=stream_filter, B=Slider(1000, range=0..1000))
stream_filter_2 = StreamFilter(Gate=rangevalue2, Stream0=data_17, Stream1=data_18, Stream2=data_19, Stream3=data_20, Stream4=data_16, Stream5=data_7)
end_points = EndPoints(Curve=line_sdl)  # -> Start, End
# METRIC1
# Change in Ratio of Amenities per hexagon
# METRIC2
gradient_8 = Gradient(LowerLimit=0, UpperLimit=1, Parameter=flatten(graph_mapper_7), stops=[0.15: RGB(255, 255, 255), 0.85: RGB(220, 0, 40)])
data_22 = Data(gradient_8)
stream_filter_3 = StreamFilter(Gate=rangevalue2, Stream0=data_15, Stream1=data_22, Stream2=data_14, Stream3=data_13, Stream4=data_12, Stream5=data_5)
xz_plane = XZPlane(Origin=end_points.End)
# METRIC
# Predicted Budget allotment for each district
mesh_colours = MeshColours(Mesh=graft(surface_5), Colours=graft(gradient_3))
stream_filter_4 = StreamFilter(Gate=Toggle(False), Stream1=mesh_colours)

# ---- group: RH_OUT:BudgetMesh
mesh = Mesh(simplify(stream_filter_4))

# ----
surface_6 = Surface(curve_2)
construct_domain_4 = ConstructDomain(DomainStart=0, DomainEnd=Slider(18, range=0..100))
area_7 = Area(Geometry=surface_6)  # -> Area, Centroid
line_sdl_2 = LineSDL(Start=area_7.Centroid, Direction=Vector(0, 0, 1), Length=multiplication_13)
end_points_2 = EndPoints(Curve=line_sdl_2)  # -> Start, graft(End)
rectangle = Rectangle(Plane=area_7.Centroid, XSize=construct_domain_4, YSize=construct_domain_4, Radius=0)  # -> Rectangle, Length
closest_point_4 = ClosestPoint(Point=point, Cloud=area_7.Centroid)  # -> ClosestPoint, CPIndex, Distance
xz_plane_2 = XZPlane(Origin=end_points_2.End)
unit_z = UnitZ(Factor=multiplication_13)
surface_7 = Surface(rectangle.Rectangle)
extrude = Extrude(Base=surface_7, Direction=unit_z)
tree_branch_6 = TreeBranch(Tree=simplify(stream_filter_2), Path=closest_point_4.CPIndex, MaintainPaths=True)
tree_branch_7 = TreeBranch(Tree=simplify(xz_plane_2), Path=closest_point_4.CPIndex, MaintainPaths=True)
data_23 = Data(flatten(stream_filter_2))
data_24 = Data(flatten(xz_plane_2))
cull_index_2 = CullIndex(List=data_23, Indices=closest_point_4.CPIndex, Wrap=True)
cull_index_3 = CullIndex(List=data_24, Indices=closest_point_4.CPIndex, Wrap=True)
stream_filter_5 = StreamFilter(Gate=boolean, Stream1=extrude)
xy_plane_2 = XYPlane(Origin=Point(0, 0, 0))
boolean_toggle_3 = BooleanToggle(True)
stream_filter_6 = StreamFilter(Gate=boolean, Stream0=surface_6, Stream1=stream_filter_5)
text = Text("Arial")
bool = Boolean(False)
region_union_2 = RegionUnion(Curves=data_3, Plane=xy_plane_2)
area_8 = Area(Geometry=stream_filter_6)  # -> Area, Centroid
c_script = CSharpScript(
    face=text,
    bold=bool,
    italics=boolean_toggle_3,
    size=Slider(74, range=0..100),
    content=flatten(tree_branch_6),
    pl=flatten(tree_branch_7))  # -> out, simplify(A); inputs face: String, bold: Boolean, italics: Boolean, size: Double, content: String, pl: Plane
# ---------- c_script: C# usings ----------
using System.IO;
using System.Linq;
using System.Data;
using System.Drawing;
using System.Reflection;
using System.Windows.Forms;
using System.Xml;
using System.Xml.Linq;
using System.Runtime.InteropServices;

using Rhino.DocObjects;
using Rhino.Collections;
using GH_IO;
using GH_IO.Serialization;
# ---------- c_script: C# ----------
    if(size == 0)
      size = 1;

    if(!string.IsNullOrEmpty(face) && size > 0 && !string.IsNullOrEmpty(content) &&
      pl.IsValid)
    {
      using (var doc = Rhino.RhinoDoc.CreateHeadless(null))
      {
        var te = doc.Objects.AddText(content, pl, size, face, bold, italics);
        var txt = doc.Objects.Find(te) as Rhino.DocObjects.TextObject;

        if(txt != null)
        {
          var tt = txt.Geometry as Rhino.Geometry.TextEntity;
          A = tt.Explode();
        }
      }
    }
# ---------- end c_script ----------

stream_filter_7 = StreamFilter(Gate=boolean_2, Stream0=circle, Stream1=region_union_2)
point_in_curve_2 = PointInCurve(Point=area_4.Centroid, Curve=stream_filter_7)  # -> Relationship, Point
panel_34 = Panel(point_in_curve_2.Relationship)
member_index = MemberIndex(Set=panel_34, Member="2")  # -> Index, Count
list_item_19 = ListItem(List=surface, Index=member_index.Index, Wrap=True)
list_item_20 = ListItem(List=gradient, Index=member_index.Index, Wrap=True)
mesh_colours_2 = MeshColours(Mesh=graft(list_item_19), Colours=graft(list_item_20))
c_script_2 = CSharpScript(
    face=text,
    bold=bool,
    italics=boolean_toggle_3,
    size=Slider(50, range=0..100),
    content=flatten(sort_text.Keys),
    pl=flatten(xz_plane))  # -> out, simplify(A); inputs face: String, bold: Boolean, italics: Boolean, size: Double, content: String, pl: Plane; same code as c_script
stream_filter_8 = StreamFilter(Gate=boolean_2, Stream0=circle, Stream1=region_union_2)
mesh_2 = Mesh(mesh_colours_2)
stream_filter_9 = StreamFilter(Gate=boolean, Stream1=mesh_2)

# ---- group: RH_OUT:crvs
crv_3 = Curve(simplify(c_script_2.A))

# ---- group: RH_OUT:ClassMesh
mesh_3 = Mesh(simplify(stream_filter_9))

# ----
bounding_box = BoundingBox(Content=flatten(mesh_3), Plane=PlaneXY(0, 0, 0), UnionBox=True)  # -> Box, Box_2
area_9 = Area(Geometry=bounding_box.Box)  # -> Area, Centroid
scale = Scale(Geometry=mesh_3, Center=area_9.Centroid, Factor=number_slider_4)  # -> Geometry, Transform
scale_2 = Scale(Geometry=mesh, Center=area_9.Centroid, Factor=number_slider_4)  # -> Geometry, Transform
scale_3 = Scale(Geometry=crv_3, Center=area_9.Centroid, Factor=number_slider_4)  # -> Geometry, Transform
scale_4 = Scale(Geometry=crv_2, Center=area_9.Centroid, Factor=number_slider_4)  # -> Geometry, Transform
move = Move(Geometry=scale.Geometry, Motion=construct_point)  # -> Geometry, Transform
move_2 = Move(Geometry=scale_2.Geometry, Motion=construct_point)  # -> Geometry, Transform
move_3 = Move(Geometry=scale_3.Geometry, Motion=construct_point)  # -> Geometry, Transform
move_4 = Move(Geometry=scale_4.Geometry, Motion=construct_point)  # -> Geometry, Transform

point_in_curve_3 = PointInCurve(Point=area_8.Centroid, Curve=stream_filter_8)  # -> Relationship, Point
panel_35 = Panel(point_in_curve_3.Relationship)
member_index_2 = MemberIndex(Set=panel_35, Member="2")  # -> Index, Count
list_item_21 = ListItem(List=stream_filter_6, Index=member_index_2.Index, Wrap=True)
list_item_22 = ListItem(List=stream_filter_3, Index=member_index_2.Index, Wrap=True)
mesh_colours_3 = MeshColours(Mesh=graft(list_item_21), Colours=graft(list_item_22))

list_item_23 = ListItem(List=cull_index_3, Index=member_index_2.Index, Wrap=True)
list_item_24 = ListItem(List=cull_index_2, Index=member_index_2.Index, Wrap=True)

c_script_3 = CSharpScript(
    face=text,
    bold=bool,
    italics=boolean_toggle_3,
    size=Slider(12, range=0..100),
    content=flatten(list_item_24),
    pl=flatten(list_item_23))  # -> out, simplify(A); inputs face: String, bold: Boolean, italics: Boolean, size: Double, content: String, pl: Plane; same code as c_script
merge_2 = Merge(Data1=c_script_3.A, Data2=simplify(c_script.A))
stream_filter_10 = StreamFilter(Gate=boolean, Stream1=merge_2)

# ---- group: RH_OUT:ColMesh
mesh_4 = Mesh(simplify(mesh_colours_3))

# ---- group: RH_OUT:crvsm
crv_4 = Curve(simplify(stream_filter_10))

# ----
scale_5 = Scale(Geometry=mesh_4, Center=area_9.Centroid, Factor=number_slider_4)  # -> Geometry, Transform
scale_6 = Scale(Geometry=crv_4, Center=area_9.Centroid, Factor=number_slider_4)  # -> Geometry, Transform
move_5 = Move(Geometry=scale_5.Geometry, Motion=construct_point)  # -> Geometry, Transform
move_6 = Move(Geometry=scale_6.Geometry, Motion=construct_point)  # -> Geometry, Transform
